# Grasshopper definition Vase_Shape_opt.gh (Grasshopper 1.0.8)
# Copyright: hrntsm
# plug-ins: Tunny

height1 = Slider(100, range=50..100)
height2 = Slider(160, range=110..160)
Z = UnitZ(Factor=Slider(200, range=0..1000))
pt = Point(Point(0, 0, 0))
Z_2 = UnitZ(Factor=height1)
Z_3 = UnitZ(Factor=height2)
move = Move(Geometry=pt, Motion=Z_2)  # -> Geometry, Transform
move_2 = Move(Geometry=pt, Motion=Z_3)  # -> Geometry, Transform
move_3 = Move(Geometry=pt, Motion=Z)  # -> Geometry, Transform
radius4 = Slider(46, range=10..100)
radius3 = Slider(37, range=10..100)
radius2 = Slider(100, range=10..100)
radius1 = Slider(55, range=10..100)
cir = Circle(Plane=move_3.Geometry, Radius=radius4)
cir_2 = Circle(Plane=PlaneXY(0, 0, 0), Radius=radius1)
cir_3 = Circle(Plane=move.Geometry, Radius=radius2)
cir_4 = Circle(Plane=move_2.Geometry, Radius=radius3)
merge = Merge(Data1=cir_2, Data2=cir_3, Data3=cir_4, Data4=cir)
boundary = BoundarySurfaces(Edges=cir_2)
loft = Loft(Curves=merge, Options={Adjust=False, Closed=False, LoftEnds=0, LoftSimp=0, LoftType=0, Rebuild=10, Refit=0.01})
join = BrepJoin(Breps=[boundary, loft])  # -> Breps, Closed
preview = CustomPreview(Geometry=join.Breps, Material=ColourSwatch(SwatchColor=RGB(255, 238, 0)))
fpcap = FishPrintByCapture()

# ----
# Human-in-the-loop optimization is performed by
# inputting FishPrint into Objective.
vase_capture = FishPrint(fpcap)

tunny = Tunny(Variables=[radius1, radius2, radius3, radius4, height1, height2], Objectives=vase_capture)  # -> Info, Fishes
