# Grasshopper definition save_artifact_to_trial.gh (Grasshopper 1.0.8)
# plug-ins: Tunny

number_slider = Slider(0.13, range=0.1..2)
geo = Geometry([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])
scale = Scale(Geometry=geo, Center=Point(0, 0, 0), Factor=number_slider)  # -> Geometry, Transform
volume = Volume(Geometry=scale.Geometry)  # -> Volume, Centroid
ma = MassAddition(Input=volume.Volume)  # -> Result, PartialResults

# ----
# The geometry itself can be saved
# and viewed as a 3d model
# from the dashboard
geo_2 = Geometry(scale.Geometry)

# ----
# You can also capture the geometry of interest
# and view the image on the dashboard.
fpcap = FishPrintByCapture()

# ----
# You can also save an any file,
# such as a csv file, for example,
# by specifying the file path.
path = FilePath()

volume_2 = Number(ma.Result)
tunny = Tunny(Variables=number_slider, Objectives=volume_2, Artifacts=[geo_2, fpcap])  # -> Info, Fishes
