# Grasshopper definition optimization_with_constraint.gh (Grasshopper 1.0.8)
# Copyright: hrntsm
# plug-ins: Tunny

x = Slider(3, range=-15..30)
y = Slider(18, range=-15..30)
expression = Expression(x=x, y=y, Expression="(x-5)^2+(y-5)^2")
expression_2 = Expression(x=x, y=y, Expression="4* x^2 + 4*y^2")
v0 = Number(expression_2)
subtraction = Subtraction(A=Slider(1000, range=0..1000), B=v0)
v1 = Number(expression)
subtraction_2 = Subtraction(A=Slider(500, range=0..1000), B=v1)
constrfa = ConstructFishAttribute(Direction="-1", Constraint=[subtraction, subtraction_2])
tunny = Tunny(Variables=[x, y], Objectives=[v0, v1], Attributes=constrfa)  # -> Info, Fishes
