# Grasshopper definition optimization_with_initial_values.gh (Grasshopper 1.0.8)
# plug-ins: Tunny

# ----
# Move the slider to the combination of variables
# you want to execute first and press the Lay button
# to save that combination and execute it first.
x0 = Slider(0.834, range=0..10)
x1 = Slider(3.985, range=0..10)
constrfegg = ConstructFishEgg(Variables=[x0, x1], LayEgg=Button(), Clear=False)

addition = Addition(A=x0, B=x1)
add = Number(addition)
panel = Panel(constrfegg)
tunny = Tunny(Variables=[constrfegg, x0, x1], Objectives=add)  # -> Info, Fishes
