# Grasshopper definition optimization_without_ui.gh (Grasshopper 1.0.8)
# Copyright: hrntsm
# plug-ins: Tunny

x = Slider(23, range=-15..30)
y = Slider(12, range=-15..30)
expression = Expression(x=x, y=y, Expression="(x-5)^2+(y-5)^2")
expression_2 = Expression(x=x, y=y, Expression="4* x^2 + 4*y^2")
v0 = Number(expression_2)
subtraction = Subtraction(A=Slider(1000, range=0..1000), B=v0)
v1 = Number(expression)
subtraction_2 = Subtraction(A=Slider(500, range=0..1000), B=v1)
constrfa = ConstructFishAttribute(Constraint=[subtraction, subtraction_2])
smaller = SmallerThan(FirstNumber=subtraction, SecondNumber=0)  # -> SmallerThan, OrEqualTo
zombie = ZombieFish(Variables=[x, y], Objectives=[v0, v1], Attributes=constrfa, Start=Toggle(False), Stop=smaller.SmallerThan)  # -> Info, AllFishes, BestFishes
panel = Panel(zombie.AllFishes)
panel_2 = Panel(zombie.Info)
panel_3 = Panel(zombie.BestFishes)
