# Grasshopper definition result_handling_example.gh (Grasshopper 1.0.8)
# plug-ins: Tunny

# ----
# Support genepool
genes = GenePool(Decimals=2, Maximum=10, Minimum=-10, Value=[8.55, -9.71, -8.55])

# ----
# These slider are used for optimization as a variable.
# Nickname is recommended to make the results easier to understand.
x1 = Slider(-8.09, range=-10..10)
x2 = Slider(-2.71, range=-10..10)
x3 = Slider(-6.65, range=-10..10)

# ----
# You can specify the direction of optimization.
# -1 means minimization,
# 1 means maximization, and here,
#  the first and second objective functions will be minimized,
# while the third objective function will be maximized.
number_slider = Slider(-1, range=-1..1)
merge = Merge(Data1=number_slider, Data2=number_slider, Data3=Slider(1, range=0..1))

# ----
# It is now possible to specify the combination of variables to be performed in the optimization.
# For example, a good combination of variables obtained by manipulating the number slider by hand can be reflected in the optimization.
# "Lay" to True will record the current variable combination.
button = Button()
constrfegg = ConstructFishEgg(Variables=[x1, x2, x3, genes], LayEgg=Button(), Clear=button)

# ---- group: Geometry
num2pt = NumbersToPoints(Numbers=genes, Mask=4)
pt = ConstructPoint(XCoordinate=x1, YCoordinate=x2, ZCoordinate=x3)
box = Box2Pt(PointA=num2pt, PointB=pt, Plane=PlaneXY(0, 0, 0))
ln = Line(StartPoint=num2pt, EndPoint=pt)
volume = Volume(Geometry=box)  # -> Volume, Centroid

# ----
x1_2 = Expression(x1=x1, x2=x2, Expression="(x1-5)^2 + (x2-5)^2")
x1_3 = Expression(x1=x1, x2=x2, Expression="4*x1^2 + 4*x2^2")

# ----
# A value strictly larger than 0 means that a constraints is violated.
# A value equal to or smaller than 0 is considered feasible.
# Here a constraint condition is set that
# the value of v0 is greater than or equal to 200
panel = Panel("200")
subtraction = Subtraction(A=panel, B=x1_3)

# ----
# Input the objective
# value separately.
brep_volume = Number(volume.Volume)
v0 = Number(x1_3)
v1 = Number(x1_2)

# ----
# Multi attributes support
# The number of Attributes can be increased
# to any number as ZUI is supported
len = Length(Curve=ln)
brep = Brep(box)
num = Number(genes)
crv = Curve(ln)
constrfa = ConstructFishAttribute(Geometry=[brep, crv], Direction=merge, Constraint=subtraction, Attr1=len, Attr2=num)

# ----
# Double-click the icon to open
# the optimization window.
tunny = Tunny(Variables=[x1, x2, x3, genes, constrfegg], Objectives=[v0, v1, brep_volume], Attributes=constrfa)  # -> Info, Fishes

# ----
# The Fish component
# handle the Tunny results.
fish = Fish([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])

panel_2 = Panel(fish)

# ----
# Results can be arrayed in Rhino's viewport
xy = XYPlane(Origin=Point(0, 0, 0))
fmarket = FishMarket(
    Fishes=fish,
    Plane=xy,
    XNum=Slider(10, range=0..10),
    XInterval=Slider(46, range=0..100),
    YInterval=Slider(60, range=0..100),
    TextSize=1)

# ----
# A breakdown of the analysis results can be retrieved by using the Deconstruct component.
# The paths in the data tree are matched to the trial numbers in the optimization.
# Right-click and select "match outputs" to
# automatically generate outputs according
# to the Attribute set in the optimization.
deconf = DeconstructFish(Fishes=fish)  # -> NumberVariables, TextVariables, Objectives, Attributes
deconfa = DeconstructFishAttribute(Attributes=deconf.Attributes)  # -> Geometry, Constraint, Attr1, Attr2
panel_3 = Panel(deconf.Objectives)
panel_4 = Panel(deconf.NumberVariables)
panel_5 = Panel(deconfa.Attr1)
panel_6 = Panel(deconfa.Attr2)
panel_7 = Panel(deconfa.Geometry)
geo = Geometry(deconfa.Geometry)
