# Grasshopper definition sample.gh (Grasshopper 1.0.7)
# plug-ins: Tunny Info

# ----
# Support genepool
genes = GenePool(Decimals=2, Maximum=10, Minimum=-10, Value=[-6.171940744, -0.6913659779, 1.856941526])

# ----
# These slider are used for optimization as a variable.
# Nickname is recommended to make the results easier to understand.
x1 = Slider(-9.07, range=-10..10)
x2 = Slider(-9.11, range=-10..10)
x3 = Slider(-0.4, range=-10..10)

# ---- group: Booth function
expression = Expression(x1=x1, x2=x2, Expression="(x1+2*x2-7)^2 + (2*x1+x2-5)^2")

# ---- group: Brep Volume
pt = ConstructPoint(XCoordinate=x1, YCoordinate=x2, ZCoordinate=x3)
num2pt = NumbersToPoints(Numbers=genes, Mask=4)
box = Box2Pt(PointA=num2pt, PointB=pt, Plane=PlaneXY(0, 0, 0))
volume = Volume(Geometry=box)  # -> Volume, Centroid

# ---- group: Simple Addition
addition = Addition(A=x1, B=x2)

# ----
# Input the objective
# value separately.
booth_function = Number(expression)
brep_volume = Number(volume.Volume)
addition_2 = Number(addition)

# ----
# If mesh data is given in a list,
# only the first mesh will be saved
mesh = Mesh(box)

# ----
# Double-click the icon to open
# the optimization window.
tunny = Tunny(Variables=[x1, x2, x3, genes], Objectives=[addition_2, booth_function, brep_volume], ModelMesh=mesh)  # -> ResultVariables, ResultObjectives, ResultMesh
