# Grasshopper definition Karamba3d_column_position_opt.gh (Grasshopper 1.0.7)
# plug-ins: Karamba3D, Tunny

# ---- group: Create Geometry
genes = GenePool(
    Decimals=2,
    Maximum=1,
    Minimum=0,
    Value=[0.01, 0.19, 0, 0.94, 0.56, 0.19, 0.88, 0.81, 0, 0.68, 0.56, 0.96, 0.52, 0.69, 0.7, 0.58, 0.97, 0.95, 0.96, 0.63])
genes_2 = GenePool(
    Decimals=2,
    Maximum=1,
    Minimum=0,
    Value=[0.45, 0.24, 0.97, 0.79, 0.6, 0.41, 0.01, 0.62, 0.04, 0.96, 0.12, 0.88, 0.96, 0.33, 0.98, 0.43, 0.62, 0.5, 0.93, 0.3])
remap = RemapNumbers(Value=genes_2, Source=Domain(0, 1), Target="0.15 to 0.85")  # -> Mapped, Clipped
remap_2 = RemapNumbers(Value=genes, Source=Domain(0, 1), Target="-3.5 to 3.5")  # -> Mapped, Clipped
# 03 - Optimization of Inclined Column Positions
# Difficulty: Hard (PRO version only)
# The position of inclined columns for a shell roof structure is optimized. This shows how beams and shells are integrated into a single model.
# 3d shapes are used during the optimization to reduce the columns from intersecting predefined regions. The surface, boxes and region of columns can be altered.
srf = Surface(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)
dispatch = Dispatch(List=remap.Mapped, DispatchPattern=[True, False])  # -> ListA, ListB
vec = VectorXYZ(XComponent=dispatch.ListA, YComponent=dispatch.ListB, ZComponent=0)  # -> Vector, Length
evalsrf = EvaluateSurface(Surface=reparameterize(srf), Point=vec.Vector)  # -> Point, Normal, UDirection, VDirection, Frame
devec = DeconstructVector(Vector=evalsrf.Point)  # -> XComponent, YComponent, ZComponent
dispatch_2 = Dispatch(List=remap_2.Mapped, DispatchPattern=[True, False])  # -> ListA, ListB
crv = Curve(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)
addition = Addition(A=devec.XComponent, B=dispatch_2.ListA)
addition_2 = Addition(A=devec.YComponent, B=dispatch_2.ListB)
pt = ConstructPoint(XCoordinate=addition, YCoordinate=addition_2, ZCoordinate=0)
boundary = BoundarySurfaces(Edges=crv)
r = Slider(1.5, range=0.5..4)
pull = PullPoint(Point=pt, Geometry=boundary, ClosestOnly=True)  # -> ClosestPoint, Distance
preview = CustomPreview(Geometry=boundary, Shader=ColourSwatch(SwatchColor=RGB(207, 207, 207)))
pt_2 = Point(evalsrf.Point)
mesh_breps = MeshBreps(
    Brep=srf,
    InclusionPoints=pt_2,
    MeshResolution=r,
    EdgeRefinementFactor=0.67,
    PointReduction=False,
    SmoothingStepSize=0.8,
    SmoothingIterations=5)  # -> Mesh, Info
ln = Line(StartPoint=pt_2, EndPoint=pull.ClosestPoint)

# ---- group: Define Materials
matselect = MaterialSelectionKaramba3D(menu=[dropdown(1), dropdown(2)])

matselect_2 = MaterialSelectionKaramba3D(menu=[dropdown(9), dropdown(19)])

# ---- group: Define Cross Sections
range = Range(Domain="0.5 to 1.5", Steps=10)
concat = Concatenate(FragmentA="shell", FragmentB=range)
cross_section = CrossSectionKaramba3D(
    FamilyNameOfCrossSection="shell",
    NameOfCrossSection=graft(concat),
    Material=matselect_2,
    Height_cm=graft(range),
    mode="Shell - Const")  # -> flatten(CrossSection)
crosecselect = CrossSectionSelectorKaramba3D(CrossSections=cross_section)  # -> CrossSection, Info

range_2 = Range(Domain="0.5 to 3.5", Steps=10)
concat_2 = Concatenate(FragmentA="r", FragmentB=range_2)
cross_section_2 = CrossSectionKaramba3D(
    FamilyNameOfCrossSection="r",
    NameOfCrossSection=concat_2,
    Material=matselect,
    Diameter_cm=range_2,
    WallThickness_cm=expr("x*0.1", range_2),
    mode="Circular Hollow")
crosecselect_2 = CrossSectionSelectorKaramba3D(CrossSections=cross_section_2)  # -> CrossSection, Info

# ---- group: Define Joints
beam_joints = BeamJointsKaramba(
    ElementIdentifiers="b",
    CtKNMAtStartingNode=Vector(0, 0, 0),
    CrKNmRadAtStartingNode="{0,1,1}",
    CtKNMAtEndNode=Vector(0, 0, 0),
    CrKNmRadAtEndNode=Vector(0, 0, 0),
    menu=[buttons(off, off, off, off, on, on), buttons(off, off, off, off, off, off)])

# ---- group: Define Elements
meshtoshell = MeshToShellKaramba3D(Mesh=mesh_breps.Mesh, Identifier="s", CrossSection=crosecselect.CrossSection, LimitDistance_m=0.005)  # -> Element, Points, Info
linetobeam = LineToBeamKaramba3D(
    Line=ln,
    Identifier="b",
    CrossSection=crosecselect_2.CrossSection,
    New=True,
    Remove=True,
    LimitDistance_m=0.005,
    Bending=True,
    SetBucklingLength=True,
    ToPolylineMaxAngle=0.03,
    ToPolylineTolerance=0.01,
    ToPolylineMinEdgeLength=0.25)  # -> Element, Points, Info

# ---- group: Define Supports
supp = SupportKaramba3D(PosInd=pull.ClosestPoint, menu=[buttons(on, on, on, off, off, off)])

# ---- group: Define Loads
panel = Panel("""{0,0,-1}
{2,0,0}
{0,2,0}
{-2,0,0}
{0,-2,0}""")
panel_2 = Panel("{0,0,1.35}")
loads = LoadsKaramba3D(Vector=panel, Mesh=mesh_breps.Mesh, LCase="0", mode="MeshLoad -Const.", menu=[buttons(off, off, on), buttons(on, off)])

# ----
# The Karamba3d part uses a modified official sample.
# Please check the following URL for details.
# https://karamba3d.com/examples/optimization-of-column-positions/
loads_2 = LoadsKaramba3D(Vector=panel_2, LCase="0", mode="Gravity")
mesh = Mesh([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])
mjoin = MeshJoin(Meshes=mesh)
mcx = MeshCurve(Mesh=mjoin, Curve=ln)  # -> flatten(Points), Faces
lng = ListLength(List=mcx.Points)  # -> expr("x/2", Length)

# ---- group: Define Loads (continued)
load = LoadKaramba3D(flatten([loads, loads_2]))

# ---- group: Assemble Model
assemble = AssembleModelKaramba3D(
    Elem=flatten([linetobeam.Element, meshtoshell.Element]),
    Support=supp,
    Load=load,
    Joint=beam_joints,
    LimitDistance_m=5e-07)  # -> Model, Info, Mass_kg, CenterOfGravity, LoadCaseNames

# ---- group: Analyze Model - FREE VERSION
analyze = AnalyzeKaramba3D(Model=assemble.Model)  # -> CalculatedModel, MaximumDisplacement_cm, ResultingForceOfGravity_kN, ElasticEnergy_kNm

# ---- group: View Results
modelview = ModelViewKaramba3D(Model=analyze.CalculatedModel, ResultFactors=1, ResultCase=-1)  # -> Model, DeformedMesh, DeformedAxes, DeformedModel
shellview = ShellViewKaramba3D(Model=modelview.Model, IndexOfLayer=0)  # -> Model, MeshesOfRenderedShells, LegendColors, LegendTags
beamview = BeamViewKaramba3D(Model=modelview.Model)  # -> Model, MeshesOfRenderedBeams, DeformedBeamAxes, LegendColors, LegendTags
legend = Legend(Colour=beamview.LegendColors, Tags=beamview.LegendTags, LegendType=1)
legend_2 = Legend(Colour=shellview.LegendColors, Tags=shellview.LegendTags, LegendType=1)

# ----
# The FishPrintByCapture component retrieves
# a capture of the currently active Rhino viewport.
# 
# This image is used for human-in-the-loop optimization,
# so set the angle you want to see on the Rhino side.
# 
# In the case of this sample, the columm position is used as a parameter,
# so we recommend an angle at which the pillar position is easy to see.
fpcap = FishPrintByCapture(Geometry=[shellview.MeshesOfRenderedShells, beamview.MeshesOfRenderedBeams])

# ----
# Constraints are set so that columns are not
# generated in zones where we do not want them to be.
constrfa = ConstructFishAttribute(Constraint=lng)

# ----
# This sample performs strain energy minimization
# and optimization for a person's evaluation of the
# model's shape as seen through the viewport.
viewport_image = FishPrint(fpcap)
strain_energy = Number(analyze.ElasticEnergy_kNm)
tunny = Tunny(Variables=[genes_2, genes], Objectives=[strain_energy, viewport_image], Attributes=constrfa)
