# Grasshopper definition save_artifact_to_trial.gh (Grasshopper 1.0.7)
# plug-ins: Tunny

number_slider = Slider(0.13, range=0.1..2)
geo = Geometry([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])
scale = Scale(Geometry=geo, Center=Point(0, 0, 0), Factor=number_slider)  # -> Geometry, Transform
volume = Volume(Geometry=scale.Geometry)  # -> Volume, Centroid
ma = MassAddition(Input=volume.Volume)  # -> Result, PartialResults
geo_2 = Geometry(scale.Geometry)
volume_2 = Number(ma.Result)
tunny = Tunny(Variables=number_slider, Objectives=volume_2, Artifacts=geo_2)
