# Grasshopper definition sample.gh (Grasshopper 1.0.7)
# plug-ins: Tunny Info

# ----
# Support genepool
genes = GenePool(Decimals=2, Maximum=10, Minimum=-10, Value=[8.15, 1.69, -5.53])

# ----
# These slider are used for optimization as a variable.
# Nickname is recommended to make the results easier to understand.
x1 = Slider(2.68, range=-10..10)
x2 = Slider(-3.11, range=-10..10)
x3 = Slider(-6.5, range=-10..10)

# ---- group: Geometry
pt = ConstructPoint(XCoordinate=x1, YCoordinate=x2, ZCoordinate=x3)
num2pt = NumbersToPoints(Numbers=genes, Mask=4)
box = Box2Pt(PointA=num2pt, PointB=pt, Plane=PlaneXY(0, 0, 0))
ln = Line(StartPoint=num2pt, EndPoint=pt)
volume = Volume(Geometry=box)  # -> Volume, Centroid

# ----
x1_2 = Expression(x1=x1, x2=x2, Expression="(x1-5)^2 + (x2-5)^2")
x1_3 = Expression(x1=x1, x2=x2, Expression="4*x1^2 + 4*x2^2")

# ----
# A value strictly larger than 0 means that a constraints is violated.
# A value equal to or smaller than 0 is considered feasible.
# Here a constraint condition is set that
# the value of v0 is greater than or equal to 200
panel = Panel("200")
subtraction = Subtraction(A=panel, B=x1_3)

constregg = ConstructFishEgg(Variables=[x1, x2, x3, genes], LayEgg=Button(), Clear=Button())
egg = FishEgg(constregg)
panel_2 = Panel(constregg)

# ----
# Input the objective
# value separately.
brep_volume = Number(volume.Volume)
v0 = Number(x1_3)
v1 = Number(x1_2)

# ----
# Multi attributes support
# The number of Attributes can be increased
# to any number as ZUI is supported
len = Length(Curve=ln)
brep = Brep(box)
crv = Curve(ln)
num = Number(genes)
constrfa = ConstructFishAttribute(Geometry=[brep, crv], Constraint=subtraction, Length=len, Genelist=num)

# ----
# Double-click the icon to open
# the optimization window.
tunny = Tunny(Variables=[x1, x2, x3, genes], Objectives=[v0, v1, brep_volume], Attributes=constrfa)

# ----
# The Fish component
# handle the Tunny results.
fish = Fish([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])

fish_2 = Fish(tunny)
panel_3 = Panel(fish)

# ----
# Results can be arrayed in Rhino's viewport
xy = XYPlane(Origin=Point(0, 0, 0))
fmarket = FishMarket(
    Fishes=fish,
    Plane=xy,
    XNum=Slider(10, range=0..10),
    XInterval=Slider(46, range=0..100),
    YInterval=Slider(60, range=0..100),
    TextSize=1)

# ----
# A breakdown of the analysis results can be retrieved by using the Deconstruct component.
# The paths in the data tree are matched to the trial numbers in the optimization.
deconf = DeconstructFish(Fishes=fish)  # -> Variables, Objectives, Attributes
panel_4 = Panel(deconf.Variables)
panel_5 = Panel(deconf.Objectives)
# Right-click and select "match outputs" to
# automatically generate outputs according
# to the Attribute set in the optimization.
deconfa = DeconstructFishAttribute(Attributes=deconf.Attributes)  # -> Constraint, Geometry, Genelist, Length
panel_6 = Panel(deconfa.Genelist)
panel_7 = Panel(deconfa.Length)
panel_8 = Panel(deconfa.Constraint)

geo = Geometry(deconfa.Geometry)
